# Dynamo graph law21_1.dyn (Dynamo 2.6.1.8786)
# packages: Test package 0.0.1

# group: 入力情報
mainStrucElements = Custom[mainStrucElements]()  # package Test package; 主要構造部Elements
categories = Categories("OST_ProjectInformation")
all_elements_of_category = ElementsOfCategory(Category=categories)
categories_2 = Categories("OST_Levels")
all_elements_of_category_2 = ElementsOfCategory(Category=categories_2)
code_block = CodeBlock { "AboveGround"; "Height"; }

# group: 第21条1判定
law21_1 = Custom[law21_1](element=mainStrucElements)  # package Test package; 基準法21条1項の判定

# group: 例外処理
対象建築物判定 = Python(IN[0]=all_elements_of_category)  # graph output
# ---------- 対象建築物判定.python (14 lines) ----------
# Python 標準ライブラリおよび DesignScript ライブラリをロード
import sys
import clr
clr.AddReference('ProtoGeometry')
from Autodesk.DesignScript.Geometry import *

# このノードへの入力は、リスト形式で IN 変数に格納されます。
dataEnteringNode = IN[0]

"""
判定なし
"""
# 出力を OUT 変数に割り当てます。
OUT = False
# ----------------------------------------

not_ = Not(x=対象建築物判定)
logicalANDSwitch = Custom[logicalANDSwitch](value=law21_1.ok, bools=not_)  # package Test package; boolフィールドの値がすべてtrueの場合値を通過させます

# group: 条件処理
code_block_2 = CodeBlock { true; 4; 13000; 16000; ">="; }
boolParamFilter = Custom[boolParamFilter](element=all_elements_of_category_2, param=code_block.out0, value=code_block_2.out0)  # package Test package; bool型のPsetのElementsを分ける
地上4階建て以上の判定 = Python(IN[0]=boolParamFilter.ok, IN[1]=code_block_2.out1)
# ---------- 地上4階建て以上の判定.python (15 lines) ----------
# Python 標準ライブラリおよび DesignScript ライブラリをロード
import sys
import clr
clr.AddReference('ProtoGeometry')
from Autodesk.DesignScript.Geometry import *

# このノードへの入力は、リスト形式で IN 変数に格納されます。
elevations = IN[0]
num = IN[1]

OUT = False
	
# 出力を OUT 変数に割り当てます。
if len(elevations) >= num:
	OUT = True
# ----------------------------------------
intParamFilter = Custom[intParamFilter](element=all_elements_of_category, param=code_block.out1, values=code_block_2.out3, logic=code_block_2.out4)  # package Test package; 数値型プロパティに対するフィルター
建築物高さが16m以上かどうかの判定 = Python(IN[0]=intParamFilter.ok)
# ---------- 建築物高さが16m以上かどうかの判定.python (15 lines) ----------
# Python 標準ライブラリおよび DesignScript ライブラリをロード
import sys
import clr
clr.AddReference('ProtoGeometry')
from Autodesk.DesignScript.Geometry import *

# このノードへの入力は、リスト形式で IN 変数に格納されます。
elevations = IN[0]

OUT = False
# この行の下にコードを配置します
if elevations is not None and len(elevations) > 0:
	OUT = True
	
# 出力を OUT 変数に割り当てます。
# ----------------------------------------
attachedTable1_i = Custom[AttachedTable1_i](building=all_elements_of_category)  # package Test package; 別表第1の(い)に関するノード

intParamFilter_2 = Custom[intParamFilter](element=all_elements_of_category, param=code_block.out1, values=code_block_2.out2, logic=code_block_2.out4)

# group (continued): 条件処理
特殊建築物で高さが13m以上かどうかの判定 = Python(IN[0]=intParamFilter_2.ok, IN[1]=attachedTable1_i)
# ---------- 特殊建築物で高さが13m以上かどうかの判定.python (18 lines) ----------
# Python 標準ライブラリおよび DesignScript ライブラリをロード
import sys
import clr
clr.AddReference('ProtoGeometry')
from Autodesk.DesignScript.Geometry import *

# このノードへの入力は、リスト形式で IN 変数に格納されます。
elevations = IN[0]
market_category = IN[1]

OUT = False

# この行の下にコードを配置します

if len(elevations) > 0 and market_category in [5, 6]:
	OUT = True
	
# 出力を OUT 変数に割り当てます。
# ----------------------------------------
list_create = List.Create(item0=地上4階建て以上の判定, item1=建築物高さが16m以上かどうかの判定, item2=特殊建築物で高さが13m以上かどうかの判定)

logicalORSwitch = Custom[logicalORSwitch](value=logicalANDSwitch, bools=list_create)  # package Test package; boolsフィールドの値のうちどれか一つがtrueの場合値を通過させる

# group: 出力情報
file_path = Filename("..\..\tests\tests.xlsx")
code_block_3 = CodeBlock { "法第21条1"; }
code_block_4 = CodeBlock { "基準レベル"; "FireRating"; "IsExternal"; "LoadBearing"; }
list_create_2 = List.Create(item0=code_block_4.out0, item1=code_block_4.out1, item2=code_block_4.out2)
code_block_5 = CodeBlock { true; false; }

# group: 適合Elements
toExcel = Custom[toExcel](elements=logicalORSwitch, path=file_path, sheetName=code_block_3, params=list_create_2, ok=code_block_5.out0)  # package Test package; Excelに結果を出力する（汎用性は低い）

logicalANDSwitch_2 = Custom[logicalANDSwitch](value=law21_1.ng, bools=not_)
logicalORSwitch_2 = Custom[logicalORSwitch](value=logicalANDSwitch_2, bools=list_create)

# group: 不適合Elements
toExcel_2 = Custom[toExcel](elements=logicalORSwitch_2, path=file_path, sheetName=code_block_3, params=list_create_2, ok=code_block_5.out1)

# group: 例外Elements
watch = Watch(logicalORSwitch)
watch_2 = Watch(logicalANDSwitch)
