# Dynamo graph law21_2.dyn (Dynamo 2.3.1.11775)
# packages: Test package 0.0.1

# group: Input: Project Elements Wall Elements
categories = Categories("OST_ProjectInformation")
all_elements_of_category = ElementsOfCategory(Category=categories)

# group: 条件処理
code_block = CodeBlock { "TotalArea"; 3000; }
getParameterValueByName = Element.GetParameterValueByName(element=all_elements_of_category, parameterName=code_block.out0)
watch = Watch(getParameterValueByName)
gt = getParameterValueByName > code_block.out1
boolean = BoolSelector(false)
mainStrucElements = Custom[mainStrucElements](slab=boolean, roof=boolean, stair=boolean)  # package Test package; 主要構造部Elements; unwired: wall
code_block_2 = CodeBlock { "FireRating"; null; }
stringParamFilter = Custom[stringParamFilter](element=mainStrucElements, param=code_block_2.out0, values=code_block_2.out1)  # package Test package; stringのパラメータのElementsをFilterする
count = List.Count(list=stringParamFilter.ok)
code_block_3 = CodeBlock { 0; }
gt_2 = count > code_block_3
and_ = And(bool0=gt, bool1=gt_2)

code_block_4 = CodeBlock { "例外モデル"; "適合モデル"; "不適合モデル"; }

# group: 21条1項判定
第二条9項2号_い = Python()  # unwired: IN[0]
# ---------- 第二条9項2号_い.python (13 lines) ----------
# Python 標準ライブラリおよび DesignScript ライブラリをロード
import sys
import clr
clr.AddReference('ProtoGeometry')
from Autodesk.DesignScript.Geometry import *

# このノードへの入力は、リスト形式で IN 変数に格納されます。
dataEnteringNode = IN

# この行の下にコードを配置します

# 出力を OUT 変数に割り当てます。
OUT = True
# ----------------------------------------
categories_2 = Categories("OST_Walls")
all_elements_of_category_2 = ElementsOfCategory(Category=categories_2)
code_block_5 = CodeBlock { "FireRating"; "2h"; }
stringParamFilter_2 = Custom[stringParamFilter](element=all_elements_of_category_2, param=code_block_5.out0, values=code_block_5.out1)
categories_3 = Categories("OST_StructuralColumns")
all_elements_of_category_3 = ElementsOfCategory(Category=categories_3)
stringParamFilter_3 = Custom[stringParamFilter](element=all_elements_of_category_3, param=code_block_5.out0, values=code_block_5.out1)
categories_4 = Categories("OST_Floors")
all_elements_of_category_4 = ElementsOfCategory(Category=categories_4)
stringParamFilter_4 = Custom[stringParamFilter](element=all_elements_of_category_4, param=code_block_5.out0, values=code_block_5.out1)
join = List.Join(list0=stringParamFilter_2.ng, list1=stringParamFilter_3.ng, list2=stringParamFilter_4.ng)
count_2 = List.Count(list=join)
code_block_6 = CodeBlock { 0; }
gt_3 = count_2 > code_block_6
防火区画に関して = Python()  # unwired: IN[0]; same code as 第二条9項2号_い
and_2 = And(bool0=gt_3, bool1=防火区画に関して)
or_ = Or(bool0=第二条9項2号_い, bool1=and_2)

logicalANDSwitch = Custom[logicalANDSwitch](value=or_, bools=and_)  # package Test package; boolフィールドの値がすべてtrueの場合値を通過させます

# group: 結果表示
if_ = If(test=and_, false=code_block_4.out0)  # unwired: true
watch_2 = Watch(if_)
if_2 = If(test=logicalANDSwitch, true=code_block_4.out1, false=code_block_4.out2)
watch_3 = Watch(if_2)
