# Dynamo graph law22.dyn (Dynamo 2.3.1.11775)
# packages: Test package 0.0.1

# group: Input: Project Elements Wall Elements
categories = Categories("OST_ProjectInformation")
all_elements_of_category = ElementsOfCategory(Category=categories)
categories_2 = Categories("OST_Roofs")
all_elements_of_category_2 = ElementsOfCategory(Category=categories_2)

# group: 例外処理
code_block = CodeBlock { "TotalArea"; 10; "<="; }
intParamFilter = Custom[intParamFilter](element=all_elements_of_category, param=code_block.out0, value=code_block.out1, logic=code_block.out2)  # package Test package; 数値型プロパティに対するフィルター
count = List.Count(list=intParamFilter.ng)
code_block_2 = CodeBlock { 0; }
eq = count == code_block_2
code_block_3 = CodeBlock { "MarketCategory"; "物置"; "納屋"; }
list_create = List.Create(item0=code_block_3.out1, item1=code_block_3.out2)
stringParamFilter = Custom[stringParamFilter](element=all_elements_of_category, param=code_block_3.out0, values=list_create)  # package Test package; stringのパラメータのElementsをFilterする
count_2 = List.Count(list=stringParamFilter.ng)
code_block_4 = CodeBlock { 0; }
eq_2 = count_2 == code_block_4
and_ = And(bool0=eq, bool1=eq_2)
延焼のおそれがある範囲 = Python(IN[0]=all_elements_of_category_2)
# ---------- 延焼のおそれがある範囲.python (13 lines) ----------
# Python 標準ライブラリおよび DesignScript ライブラリをロード
import sys
import clr
clr.AddReference('ProtoGeometry')
from Autodesk.DesignScript.Geometry import *

# このノードへの入力は、リスト形式で IN 変数に格納されます。
dataEnteringNode = IN[0]

# この行の下にコードを配置します

# 出力を OUT 変数に割り当てます。
OUT = dataEnteringNode
# ----------------------------------------
if_ = If(test=and_, true=延焼のおそれがある範囲, false=all_elements_of_category_2)
code_block_5 = CodeBlock { "MarketCategory"; "茶屋"; "東屋"; }
list_create_2 = List.Create(item0=code_block_5.out1, item1=code_block_5.out2)
stringParamFilter_2 = Custom[stringParamFilter](element=all_elements_of_category, param=code_block_5.out0, values=list_create_2)
count_3 = List.Count(list=stringParamFilter_2.ng)
code_block_6 = CodeBlock { 0; }
ne = count_3 != code_block_6
not_ = Not(x=ne)
logicalANDSwitch = Custom[logicalANDSwitch](value=if_, bools=not_)  # package Test package; boolフィールドの値がすべてtrueの場合値を通過させます

# group: 条件処理
対象地域内か = Python()  # unwired: IN[0]
# ---------- 対象地域内か.python (13 lines) ----------
# Python 標準ライブラリおよび DesignScript ライブラリをロード
import sys
import clr
clr.AddReference('ProtoGeometry')
from Autodesk.DesignScript.Geometry import *

# このノードへの入力は、リスト形式で IN 変数に格納されます。
dataEnteringNode = IN[0]

# この行の下にコードを配置します

# 出力を OUT 変数に割り当てます。
OUT = True
# ----------------------------------------
logicalANDSwitch_2 = Custom[logicalANDSwitch](value=logicalANDSwitch, bools=対象地域内か)

# group: 22条判定
code_block_7 = CodeBlock { "FireRating"; "2h"; }
stringParamFilter_3 = Custom[stringParamFilter](element=logicalANDSwitch_2, param=code_block_7.out0, values=code_block_7.out1)

# group: 不適合Elements
color_palette = ColorPalette({R: 220, G: 20, B: 60, A: 255})
setColorOnElement = Custom[setColorOnElement](cutFillColor=color_palette, element=stringParamFilter_3.ng)  # package Test package; 指定したElementに着色を行う

# group: 適合Elements
color_palette_2 = ColorPalette({R: 0, G: 0, B: 255, A: 255})
setColorOnElement_2 = Custom[setColorOnElement](cutFillColor=color_palette_2, element=stringParamFilter_3.ok)

# group: 例外Elements
watch = Watch(logicalANDSwitch_2)
watch_2 = Watch(logicalANDSwitch)
