# Dynamo graph law23.dyn (Dynamo 2.3.1.11775)
# packages: Test package 0.0.1

# group: Input: Project Elements Wall Elements
categories = Categories("OST_ProjectInformation")
all_elements_of_category = ElementsOfCategory(Category=categories)
categories_2 = Categories("OST_Walls")
all_elements_of_category_2 = ElementsOfCategory(Category=categories_2)

# group: 条件処理
code_block = CodeBlock { "LandID"; }
getParameterValueByName = Element.GetParameterValueByName(element=all_elements_of_category, parameterName=code_block)
対象地域判定_未 = Python(IN[0]=getParameterValueByName)  # graph output
# ---------- 対象地域判定_未.python (14 lines) ----------
# Python 標準ライブラリおよび DesignScript ライブラリをロード
import sys
import clr
clr.AddReference('ProtoGeometry')
from Autodesk.DesignScript.Geometry import *

# このノードへの入力は、リスト形式で IN 変数に格納されます。
dataEnteringNode = IN[0]

"""
判定なし
"""
# 出力を OUT 変数に割り当てます。
OUT = True
# ----------------------------------------
watch = Watch(all_elements_of_category)
建築物が木造建築物等_未 = Python(IN[0]=watch)  # graph output; same code as 対象地域判定_未
code_block_2 = CodeBlock { "IsExternal"; }

boolean = BoolSelector(true)
boolParamFilter = Custom[boolParamFilter](element=all_elements_of_category_2, param=code_block_2, value=boolean)  # package Test package; bool型のPsetのElementsを分ける

# group (continued): 条件処理
指定区画内モデルを取得 = Python(IN[0]=boolParamFilter.ok)
# ---------- 指定区画内モデルを取得.python (13 lines) ----------
# Python 標準ライブラリおよび DesignScript ライブラリをロード
import sys
import clr
clr.AddReference('ProtoGeometry')
from Autodesk.DesignScript.Geometry import *

# このノードへの入力は、リスト形式で IN 変数に格納されます。
dataEnteringNode = IN[0]

# この行の下にコードを配置します

# 出力を OUT 変数に割り当てます。
OUT = dataEnteringNode
# ----------------------------------------
n23条対象モデル取得 = Python(IN[0]=対象地域判定_未, IN[1]=建築物が木造建築物等_未, IN[2]=指定区画内モデルを取得)  # "23条対象モデル取得"; graph output
# ---------- n23条対象モデル取得.python (24 lines) ----------
# Python 標準ライブラリおよび DesignScript ライブラリをロード
import sys
import clr
clr.AddReference('ProtoGeometry')
from Autodesk.DesignScript.Geometry import *

# このノードへの入力は、リスト形式で IN 変数に格納されます。
dataEnteringNode = IN

# この行の下にコードを配置します
is_target_area = IN[0]
is_wooden_building = IN[1]
target_elements = IN[2]

ok = list()
ng = list()

if is_target_area and is_wooden_building:
	ok = target_elements
else:
	ng = target_elements
	
# 出力を OUT 変数に割り当てます。
OUT = [ok, ng]
# ----------------------------------------

code_block_3 = CodeBlock { 0; 1; }

# group: 対象Elements
getItemAtIndex = List.GetItemAtIndex(list=n23条対象モデル取得, index=code_block_3.out0)

# group: 23条適合判定
code_block_4 = CodeBlock { "FireRating"; }
code_block_5 = CodeBlock { "2h"; }
list_create = List.Create(item0=code_block_5)
stringParamFilter = Custom[stringParamFilter](element=getItemAtIndex, param=code_block_4, values=list_create)  # package Test package; stringのパラメータのElementsをFilterする

# group: 適合Elements
color_palette = ColorPalette({R: 0, G: 0, B: 255, A: 255})
setColorOnElement = Custom[setColorOnElement](cutFillColor=color_palette, element=stringParamFilter.ok)  # package Test package; 指定したElementに着色を行う

# group: 不適合Elements
color_palette_2 = ColorPalette({R: 220, G: 20, B: 60, A: 255})
setColorOnElement_2 = Custom[setColorOnElement](cutFillColor=color_palette_2, element=stringParamFilter.ng)

# group: 例外Elements
getItemAtIndex_2 = List.GetItemAtIndex(list=n23条対象モデル取得, index=code_block_3.out1)

watch_2 = Watch(all_elements_of_category_2)
