# Dynamo graph law25.dyn (Dynamo 2.3.1.11775)
# packages: Test package 0.0.1

# group: Input: Project Elements Wall Elements
categories = Categories("OST_ProjectInformation")
all_elements_of_category = ElementsOfCategory(Category=categories)
categories_2 = Categories("OST_Walls")
all_elements_of_category_2 = ElementsOfCategory(Category=categories_2)
categories_3 = Categories("OST_Roofs")
all_elements_of_category_3 = ElementsOfCategory(Category=categories_3)

watch = Watch(all_elements_of_category)

# group: 条件処理
建築物が木造建築物等_未 = Python(IN[0]=all_elements_of_category)  # graph output
# ---------- 建築物が木造建築物等_未.python (16 lines) ----------
# Python 標準ライブラリおよび DesignScript ライブラリをロード
import sys
import clr
clr.AddReference('ProtoGeometry')
from Autodesk.DesignScript.Geometry import *

# このノードへの入力は、リスト形式で IN 変数に格納されます。
buildings = IN[0]

ok = list()
ng = list()
"""
判定なし
"""
# 出力を OUT 変数に割り当てます。
OUT = [buildings, ng]
# ----------------------------------------
code_block = CodeBlock { 1; }
getItemAtIndex = List.GetItemAtIndex(list=建築物が木造建築物等_未, index=code_block)
isEmpty = List.IsEmpty(list=getItemAtIndex)
code_block_2 = CodeBlock { "TotalArea"; 1000; ">="; }
intSumParamJudge = Custom[intSumParamJudge](element=all_elements_of_category, param=code_block_2.out0, value=code_block_2.out1, logic=code_block_2.out2)  # package Test package; 全てのエレメントのパラメータの合計値を判定する
and_ = And(bool0=isEmpty, bool1=intSumParamJudge)
logicalANDSwitch = Custom[logicalANDSwitch](value=all_elements_of_category_2, bools=and_)  # package Test package; boolフィールドの値がすべてtrueの場合値を通過させます
logicalANDSwitch_2 = Custom[logicalANDSwitch](value=all_elements_of_category_3, bools=and_)

# group: 25条適合判定
延焼の恐れのある部分の範囲 = Python()  # unwired: IN[0]; starter script, not edited (OUT = 0)
特定範囲内にあるElementのFilter = Python(IN[0]=logicalANDSwitch, IN[1]=延焼の恐れのある部分の範囲)
# ---------- 特定範囲内にあるElementのFilter.python (13 lines) ----------
# Python 標準ライブラリおよび DesignScript ライブラリをロード
import sys
import clr
clr.AddReference('ProtoGeometry')
from Autodesk.DesignScript.Geometry import *

# このノードへの入力は、リスト形式で IN 変数に格納されます。
dataEnteringNode = IN[0]

# この行の下にコードを配置します

# 出力を OUT 変数に割り当てます。
OUT = dataEnteringNode
# ----------------------------------------
code_block_3 = CodeBlock { "IsExternal"; }
boolParamFilter = Custom[boolParamFilter](element=特定範囲内にあるElementのFilter, param=code_block_3)  # package Test package; bool型のPsetのElementsを分ける
code_block_4 = CodeBlock { "FireRating"; "2h"; }
list_create = List.Create(item0=code_block_4.out1)
stringParamFilter = Custom[stringParamFilter](element=boolParamFilter.ok, param=code_block_4.out0, values=list_create)  # package Test package; stringのパラメータのElementsをFilterする
特定範囲内にあるElementのFilter_2 = Python(IN[0]=logicalANDSwitch_2, IN[1]=延焼の恐れのある部分の範囲)  # same code as 特定範囲内にあるElementのFilter

# group: 適合Elements
color_palette = ColorPalette({R: 0, G: 0, B: 255, A: 255})
setColorOnElement = Custom[setColorOnElement](cutFillColor=color_palette, element=stringParamFilter.ok)  # package Test package; 指定したElementに着色を行う

# group: 不適合Elements
color_palette_2 = ColorPalette({R: 220, G: 20, B: 60, A: 255})
setColorOnElement_2 = Custom[setColorOnElement](cutFillColor=color_palette_2, element=stringParamFilter.ng)

law21_1 = Custom[law21_1](element=特定範囲内にあるElementのFilter_2)  # package Test package; 基準法21条1項の判定

# group: 不適合Elements
color_palette_3 = ColorPalette({R: 220, G: 20, B: 60, A: 255})
setColorOnElement_3 = Custom[setColorOnElement](cutFillColor=color_palette_3, element=law21_1.ok)

# group: 適合Elements
color_palette_4 = ColorPalette({R: 0, G: 0, B: 255, A: 255})
setColorOnElement_4 = Custom[setColorOnElement](cutFillColor=color_palette_4, element=law21_1.ng)

watch_2 = Watch(all_elements_of_category_2)
watch_3 = Watch(all_elements_of_category_3)

# group: 例外モデル
watch_4 = Watch(logicalANDSwitch)
watch_5 = Watch(logicalANDSwitch_2)
