# Dynamo graph law26.dyn (Dynamo 2.6.1.8786)
# packages: Test package 0.0.1

# group: Input: Project Elements Wall Elements
categories = Categories("OST_Floors")
all_elements_of_category = ElementsOfCategory(Category=categories)
categories_2 = Categories("OST_ProjectInformation")
all_elements_of_category_2 = ElementsOfCategory(Category=categories_2)
code_block = CodeBlock { "TotalArea"; "FireProtectionClass"; "MarketCategory"; }
mainStrucElements = Custom[mainStrucElements]()  # package Test package; 主要構造部Elements
code_block_2 = CodeBlock { "FireRating"; }
categories_3 = Categories("OST_Walls")
all_elements_of_category_3 = ElementsOfCategory(Category=categories_3)

# group: 例外処理
code_block_3 = CodeBlock { "耐火建築物"; "準耐火建築物"; }
list_create = List.Create(item0=code_block_3.out0, item1=code_block_3.out1)
stringParamJudge = Custom[stringParamJudge](element=all_elements_of_category_2, param=code_block.out1, values=list_create)  # package Test package; 一つのElementに対する文字列パラメータの判定を行う
not_ = Not(x=stringParamJudge)
code_block_4 = CodeBlock { "卸売場の上家"; "機械製作工場"; }
list_create_2 = List.Create(item0=code_block_4.out0, item1=code_block_4.out1)
stringParamJudge_2 = Custom[stringParamJudge](element=all_elements_of_category_2, param=code_block.out2, values=list_create_2)
主要構造部が不燃材である = Python()  # unwired: IN[0]
# ---------- 主要構造部が不燃材である.python (13 lines) ----------
# Python 標準ライブラリおよび DesignScript ライブラリをロード
import sys
import clr
clr.AddReference('ProtoGeometry')
from Autodesk.DesignScript.Geometry import *

# このノードへの入力は、リスト形式で IN 変数に格納されます。
dataEnteringNode = IN

# この行の下にコードを配置します

# 出力を OUT 変数に割り当てます。
OUT = False
# ----------------------------------------
code_block_5 = CodeBlock { 30; ">="; }
intParamJudge = Custom[intParamJudge](element=mainStrucElements, param=code_block_2, value=code_block_5.out0, logic=code_block_5.out1)  # package Test package; 数値の格納されているパラメータを持つオブジェクトが指定の値をクリアしているか判定するノード
or_ = Or(bool0=主要構造部が不燃材である, bool1=intParamJudge)
and_ = And(bool0=stringParamJudge_2, bool1=or_)
not_2 = Not(x=and_)
例外条件3 = Python()  # unwired: IN[0]; same code as 主要構造部が不燃材である
not_3 = Not(x=例外条件3)
list_create_3 = List.Create(item0=not_, item1=not_2, item2=not_3)
logicalANDSwitch = Custom[logicalANDSwitch](value=all_elements_of_category_2, bools=list_create_3)  # package Test package; boolフィールドの値がすべてtrueの場合値を通過させます

# group: 条件処理
code_block_6 = CodeBlock { 1000; ">="; }
intSumParamJudge = Custom[intSumParamJudge](element=logicalANDSwitch, param=code_block.out0, value=code_block_6.out0, logic=code_block_6.out1)  # package Test package; 全てのエレメントのパラメータの合計値を判定する
logicalANDSwitch_2 = Custom[logicalANDSwitch](value=all_elements_of_category, bools=intSumParamJudge)
延焼の恐れのある部分の範囲 = Python()  # unwired: IN[0]; starter script, not edited (OUT = 0)
特定範囲内にあるElementのFilter = Python(IN[0]=logicalANDSwitch_2, IN[1]=延焼の恐れのある部分の範囲)
# ---------- 特定範囲内にあるElementのFilter.python (13 lines) ----------
# Python 標準ライブラリおよび DesignScript ライブラリをロード
import sys
import clr
clr.AddReference('ProtoGeometry')
from Autodesk.DesignScript.Geometry import *

# このノードへの入力は、リスト形式で IN 変数に格納されます。
dataEnteringNode = IN[0]

# この行の下にコードを配置します

# 出力を OUT 変数に割り当てます。
OUT = dataEnteringNode
# ----------------------------------------
logicalANDSwitch_3 = Custom[logicalANDSwitch](value=all_elements_of_category_3, bools=intSumParamJudge)
特定範囲内にあるElementのFilter_2 = Python(IN[0]=logicalANDSwitch_3, IN[1]=延焼の恐れのある部分の範囲)  # same code as 特定範囲内にあるElementのFilter

# group: 例外Elements
watch = Watch(logicalANDSwitch_2)
watch_2 = Watch(logicalANDSwitch)

対象モデル = Watch(特定範囲内にあるElementのFilter)
対象モデル_2 = Watch(特定範囲内にあるElementのFilter_2)

# group: 26条判定
code_block_7 = CodeBlock { "FireRating"; 30; ">="; }
intParamFilter = Custom[intParamFilter](element=特定範囲内にあるElementのFilter, param=code_block_7.out0, values=code_block_7.out1, logic=code_block_7.out2)  # package Test package; 数値型プロパティに対するフィルター
intParamFilter_2 = Custom[intParamFilter](element=特定範囲内にあるElementのFilter_2, param=code_block_7.out0, values=code_block_7.out1, logic=code_block_7.out2)
join = List.Join(list0=intParamFilter.ok, list1=intParamFilter_2.ok)
join_2 = List.Join(list0=intParamFilter.ng, list1=intParamFilter_2.ng)

# group: 出力情報
file_path = Filename("..\..\tests\tests.xlsx")
code_block_8 = CodeBlock { "法第26条"; }
code_block_9 = CodeBlock { "基準レベル"; "FireRating"; "IsExternal"; "LoadBearing"; }
list_create_4 = List.Create(item0=code_block_9.out0, item1=code_block_9.out1, item2=code_block_9.out2)
code_block_10 = CodeBlock { true; false; }

# group: 判定結果出力
toExcel = Custom[toExcel](elements=join, path=file_path, sheetName=code_block_8, params=list_create_4, ok=code_block_10.out0)  # package Test package; Excelに結果を出力する（汎用性は低い）

# group: 不適合Elements
toExcel_2 = Custom[toExcel](elements=join_2, path=file_path, sheetName=code_block_8, params=list_create_4, ok=code_block_10.out1)
