# Dynamo graph law27_1.dyn (Dynamo 2.6.1.8786)
# packages: Test package 0.0.1

# group: Input: Project Elements Wall Elements
categories = Categories("OST_ProjectInformation")
all_elements_of_category = ElementsOfCategory(Category=categories)
code_block = CodeBlock { "TotalArea"; "MarketCategory"; }
code_block_2 = CodeBlock { "FireProtectionClass"; "耐火建築物"; }

# group: 条件処理
attachedTable1_i = Custom[AttachedTable1_i](building=all_elements_of_category)  # package Test package; 別表第1の(い)に関するノード
attachedTable1_ro = Custom[AttachedTable1_ro](building=all_elements_of_category)  # package Test package; 別表第一の(ろ)に関するノード
第1号 = Python(IN[0]=attachedTable1_i, IN[1]=attachedTable1_ro)
# ---------- 第1号.python (18 lines) ----------
# Python 標準ライブラリおよび DesignScript ライブラリをロード
import sys
import clr
clr.AddReference('ProtoGeometry')
from Autodesk.DesignScript.Geometry import *

# このノードへの入力は、リスト形式で IN 変数に格納されます。
building_num = IN[0][0]
storey_num = IN[1]
rtn = False

# この行の下にコードを配置します
correct_building_nums = [1, 2, 3, 4]
if building_num in correct_building_nums:
	rtn = True
	
# 出力を OUT 変数に割り当てます。
OUT = rtn
# ----------------------------------------
attachedTable1_ha = Custom[AttachedTable1_ha](building=all_elements_of_category)  # package Test package; 別表第一の(は)に関するノード
code_block_3 = CodeBlock { ">="; 3000; }
intParamFilter = Custom[intParamFilter](element=all_elements_of_category, param=code_block.out0, values=attachedTable1_ha, logic=code_block_3.out0)  # package Test package; 数値型プロパティに対するフィルター
第2号 = Python(IN[0]=attachedTable1_i, IN[1]=intParamFilter.ok)
# ---------- 第2号.python (18 lines) ----------
# Python 標準ライブラリおよび DesignScript ライブラリをロード
import sys
import clr
clr.AddReference('ProtoGeometry')
from Autodesk.DesignScript.Geometry import *

# このノードへの入力は、リスト形式で IN 変数に格納されます。
building_num = IN[0][0]
total_area = IN[1]
rtn = False

# この行の下にコードを配置します
correct_building_nums = [1, 2, 3, 4]
if building_num in correct_building_nums and len(total_area) > 0:
	rtn = True
	
# 出力を OUT 変数に割り当てます。
OUT = rtn
# ----------------------------------------
intParamFilter_2 = Custom[intParamFilter](element=all_elements_of_category, param=code_block.out0, values=code_block_3.out1, logic=code_block_3.out0)
第3号 = Python(IN[0]=attachedTable1_i, IN[1]=intParamFilter_2.ok)
# ---------- 第3号.python (18 lines) ----------
# Python 標準ライブラリおよび DesignScript ライブラリをロード
import sys
import clr
clr.AddReference('ProtoGeometry')
from Autodesk.DesignScript.Geometry import *

# このノードへの入力は、リスト形式で IN 変数に格納されます。
building_num = IN[0][0]
total_area = IN[1]
rtn = False

# この行の下にコードを配置します
correct_building_nums = [4]
if int(building_num) in correct_building_nums and len(total_area) > 0:
	rtn = True
	
# 出力を OUT 変数に割り当てます。
OUT = rtn
# ----------------------------------------
code_block_4 = CodeBlock { "劇場"; "映画館"; "演芸場"; }
list_create = List.Create(item0=code_block_4.out0, item1=code_block_4.out1, item2=code_block_4.out2)
stringParamFilter = Custom[stringParamFilter](element=all_elements_of_category, param=code_block.out1, values=list_create)  # package Test package; stringのパラメータのElementsをFilterする
第4号 = Python(IN[0]=attachedTable1_i, IN[1]=stringParamFilter.ok)
# ---------- 第4号.python (18 lines) ----------
# Python 標準ライブラリおよび DesignScript ライブラリをロード
import sys
import clr
clr.AddReference('ProtoGeometry')
from Autodesk.DesignScript.Geometry import *

# このノードへの入力は、リスト形式で IN 変数に格納されます。
building_num = IN[0][0]
total_area = IN[1]
rtn = False

# この行の下にコードを配置します
correct_building_nums = [4]
if building_num in correct_building_nums and len(total_area) > 0:
	rtn = True
	
# 出力を OUT 変数に割り当てます。
OUT = rtn
# ----------------------------------------
list_create_2 = List.Create(item0=第1号, item1=第2号, item2=第3号, item3=第4号)
logicalORSwitch = Custom[logicalORSwitch](value=all_elements_of_category, bools=list_create_2)  # package Test package; boolsフィールドの値のうちどれか一つがtrueの場合値を通過させる
or_ = Or(bool0=第1号, bool1=第2号, bool2=第3号, bool3=第4号)

# group: 例外モデル
watch = Watch(logicalORSwitch)

watch_2 = Watch(all_elements_of_category)

# group: 27条第1項適合判定
list_create_3 = List.Create(item0=code_block_2.out1)
stringParamFilter_2 = Custom[stringParamFilter](element=logicalORSwitch, param=code_block_2.out0, values=list_create_3)

# group: 出力情報
file_path = Filename("..\..\tests\tests.xlsx")
code_block_5 = CodeBlock { "法第27条1"; }
code_block_6 = CodeBlock { "FireProtectionClass"; "TotalArea"; "MarketCategory"; "Height"; }
list_create_4 = List.Create(item0=code_block_6.out0, item1=code_block_6.out1, item2=code_block_6.out2, item3=code_block_6.out3)
code_block_7 = CodeBlock { true; false; }

# group: 判定結果出力
toExcel = Custom[toExcel](elements=stringParamFilter_2.ok, path=file_path, sheetName=code_block_5, params=list_create_4, overWrite=code_block_7.out0, ok=code_block_7.out0)  # package Test package; Excelに結果を出力する（汎用性は低い）

# group: 不適合Elements
toExcel_2 = Custom[toExcel](elements=stringParamFilter_2.ng, path=file_path, sheetName=code_block_5, params=list_create_4, overWrite=code_block_7.out0, ok=code_block_7.out1)
