# Dynamo graph law27_3.dyn (Dynamo 2.3.1.11775)
# packages: Test package 0.0.1

# group: Input: Project Elements Wall Elements
categories = Categories("OST_ProjectInformation")
all_elements_of_category = ElementsOfCategory(Category=categories)

watch = Watch(all_elements_of_category)

# group: 条件処理
attachedTable1_i = Custom[AttachedTable1_i](building=all_elements_of_category)  # package Test package; 別表第1の(い)に関するノード
別表第一の_い_判定 = Python(IN[0]=attachedTable1_i)
# ---------- 別表第一の_い_判定.python (16 lines) ----------
# Python 標準ライブラリおよび DesignScript ライブラリをロード
import sys
import clr
clr.AddReference('ProtoGeometry')
from Autodesk.DesignScript.Geometry import *

# このノードへの入力は、リスト形式で IN 変数に格納されます。
number = IN[0]
correct = [1, 2, 3, 4]

rtn = False
# この行の下にコードを配置します
if number[0] in correct:
	rtn = True
# 出力を OUT 変数に割り当てます。
OUT = rtn
# ----------------------------------------
logicalANDSwitch = Custom[logicalANDSwitch](value=all_elements_of_category, bools=別表第一の_い_判定)  # package Test package; boolフィールドの値がすべてtrueの場合値を通過させます
attachedTable1_ro = Custom[AttachedTable1_ro](building=logicalANDSwitch)  # package Test package; 別表第一の(ろ)に関するノード
別表第一の_ろ_の条件を満たすかどうか = Python(IN[0]=attachedTable1_ro)
# ---------- 別表第一の_ろ_の条件を満たすかどうか.python (13 lines) ----------
# Python 標準ライブラリおよび DesignScript ライブラリをロード
import sys
import clr
clr.AddReference('ProtoGeometry')
from Autodesk.DesignScript.Geometry import *

# このノードへの入力は、リスト形式で IN 変数に格納されます。
dataEnteringNode = IN

# この行の下にコードを配置します

# 出力を OUT 変数に割り当てます。
OUT = True
# ----------------------------------------
logicalANDSwitch_2 = Custom[logicalANDSwitch]()  # unwired: value, bools

attachedTable1_ha = Custom[AttachedTable1_ha](building=logicalANDSwitch)  # package Test package; 別表第一の(は)に関するノード

# group: 例外モデル
watch_2 = Watch(logicalANDSwitch)
watch_3 = Watch(logicalANDSwitch_2)

# group: 27条第3項適合判定
code_block = CodeBlock { "FireProtectionClass"; "耐火建築物"; "準耐火建築物"; }
list_create = List.Create(item0=code_block.out1, item1=code_block.out2)
stringParamFilter = Custom[stringParamFilter](param=code_block.out0, values=list_create)  # package Test package; stringのパラメータのElementsをFilterする; unwired: element

# group: 適合Elements
color_palette = ColorPalette({R: 0, G: 0, B: 255, A: 255})
setColorOnElement = Custom[setColorOnElement](cutFillColor=color_palette, element=stringParamFilter.ok)  # package Test package; 指定したElementに着色を行う

# group: 不適合Elements
color_palette_2 = ColorPalette({R: 220, G: 20, B: 60, A: 255})
setColorOnElement_2 = Custom[setColorOnElement](cutFillColor=color_palette_2, element=stringParamFilter.ng)
