# Dynamo graph setupProjectInfo.dyn (Dynamo 2.3.1.11775)

# group: Setup for TotalArea of Project Information
categories = Categories("OST_Rooms")
all_elements_of_category = ElementsOfCategory(Category=categories)
code_block = CodeBlock { "面積"; }
getParameterValueByName = Element.GetParameterValueByName(element=all_elements_of_category, parameterName=code_block)
合計面積算出 = Python(IN[0]=getParameterValueByName)
# ---------- 合計面積算出.python (18 lines) ----------
# Python 標準ライブラリおよび DesignScript ライブラリをロード
import sys
import clr
clr.AddReference('ProtoGeometry')
from Autodesk.DesignScript.Geometry import *

# このノードへの入力は、リスト形式で IN 変数に格納されます。
values = IN[0]
s = 0

# この行の下にコードを配置します
for v in values:
	if v == '':
		continue
	s += float(v)
	
# 出力を OUT 変数に割り当てます。
OUT = s
# ----------------------------------------
watch = Watch(合計面積算出)
categories_2 = Categories("OST_ProjectInformation")
all_elements_of_category_2 = ElementsOfCategory(Category=categories_2)
code_block_2 = CodeBlock { "TotalArea"; }
setParameterByName = Element.SetParameterByName(element=all_elements_of_category_2, parameterName=code_block_2, value=合計面積算出)

# group: Setup for EntranceLevel of LevelLine
categories_3 = Categories("OST_Levels")
all_elements_of_category_3 = ElementsOfCategory(Category=categories_3)
code_block_3 = CodeBlock { "高さ"; "EntranceLevel"; 0; }
getParameterValueByName_2 = Element.GetParameterValueByName(element=all_elements_of_category_3, parameterName=code_block_3.out0)
eq = getParameterValueByName_2 == code_block_3.out2
setParameterByName_2 = Element.SetParameterByName(element=all_elements_of_category_3, parameterName=code_block_3.out1, value=eq)
watch_2 = Watch(eq)
watch_3 = Watch(getParameterValueByName_2)

# group: Setup for AboveGround of LevelLine
categories_4 = Categories("OST_Levels")
all_elements_of_category_4 = ElementsOfCategory(Category=categories_4)
code_block_4 = CodeBlock { "高さ"; "AboveGround"; 0; }
getParameterValueByName_3 = Element.GetParameterValueByName(element=all_elements_of_category_4, parameterName=code_block_4.out0)
watch_4 = Watch(getParameterValueByName_3)

ge = getParameterValueByName_3 >= code_block_4.out2

# group (continued): Setup for AboveGround of LevelLine
setParameterByName_3 = Element.SetParameterByName(element=all_elements_of_category_4, parameterName=code_block_4.out1, value=ge)
watch_5 = Watch(ge)
